# Grasshopper definition 00_parametric_urban canyon_Ver2.gh (Grasshopper 1.0.8)
# plug-ins: Colibri

panel = Panel("100")
number_slider = Slider(10, range=2..10, expression="x*5")
street_width = Slider(10, range=1..10, expression="x*5")
plane_surface = PlaneSurface(Plane=PlaneXY(0, 0, 0), XSize="-75 to 75", YSize="-75 to 75")
plane_surface_2 = PlaneSurface(Plane=PlaneXY(0, 0, 0), XSize="-50 to 50", YSize="-50 to 50")
panel_2 = Panel("45")
panel_3 = Panel("5")
plane_surface_3 = PlaneSurface(Plane=PlaneXY(0, 0, 0), XSize="-75 to 75", YSize="-75 to 75")
series = Series(Start=0, Step="30", Count="7")
division = Division(A="100", B=2)
division_2 = Division(A=number_slider, B=2)
division_3 = Division(A="100", B=2)
division_4 = Division(A=street_width, B=2)
radians = Radians(Degrees=Slider(0, range=0..7, expression="x*22.5"))
point = Point(Point(0, 0, -1))
point_2 = Point(Point(0, 0, -1))
radians_2 = Radians(Degrees=series)
center_box = CenterBox(Base=point, X=division, Y=division_2, Z=1)
center_box_2 = CenterBox(Base=point_2, X=division_3, Y=division_4, Z=1)
rotate = Rotate(Geometry=center_box, Angle=radians, Plane=PlaneXY(0, 0, 0))  # -> Geometry, Transform
rotate_2 = Rotate(Geometry=center_box_2, Angle=radians_2, Plane=PlaneXY(0, 0, 0))  # -> Geometry, Transform
deconstruct_brep = DeconstructBrep(Brep=rotate.Geometry)  # -> Faces, Edges, Vertices
list_item = ListItem(List=rotate_2.Geometry, Index=Slider(0, range=0..7), Wrap=True)
deconstruct_brep_2 = DeconstructBrep(Brep=list_item)  # -> Faces, Edges, Vertices
multiplication = Multiplication(A=number_slider, B=Slider(1, range=0.2..2))
list_item_2 = ListItem(List=deconstruct_brep.Faces, Index="5", Wrap=True)
multiplication_2 = Multiplication(A=street_width, B=Slider(1, range=0.2..2))
area = Area(Geometry=list_item_2)  # -> Area, Centroid
list_item_3 = ListItem(List=deconstruct_brep_2.Faces, Index="5", Wrap=True)
unit_z = UnitZ(Factor=multiplication)
deconstruct_brep_3 = DeconstructBrep(Brep=list_item_2)  # -> Faces, Edges, Vertices
list_item_4 = ListItem(List=deconstruct_brep_3.Edges, Index="2", Wrap=True)
list_item_5 = ListItem(List=deconstruct_brep_3.Edges, Index="0", Wrap=True)
area_2 = Area(Geometry=list_item_3)  # -> Area, Centroid
unit_z_2 = UnitZ(Factor=multiplication_2)
deconstruct_brep_4 = DeconstructBrep(Brep=list_item_3)  # -> Faces, Edges, Vertices
list_item_6 = ListItem(List=deconstruct_brep_4.Edges, Index="2", Wrap=True)
list_item_7 = ListItem(List=deconstruct_brep_4.Edges, Index="0", Wrap=True)
merge = Merge(Data1=list_item_4, Data2=list_item_5)
genpts = LBGeneratePointGrid(geometry=list_item_2, grid_size="1", offset_dist="- 0.1")  # -> points, vectors, face_areas, mesh; plug-in component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
extrude = Extrude(Base=[list_item_5, list_item_4], Direction=unit_z)
join_curves = JoinCurves(Curves=deconstruct_brep_3.Edges, Preserve=False)
merge_2 = Merge(Data1=list_item_6, Data2=list_item_7)
genpts_2 = LBGeneratePointGrid(geometry=list_item_3, grid_size="1", offset_dist="- 0.1")  # -> points, vectors, face_areas, mesh; plug-in component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
extrude_2 = Extrude(Base=[list_item_7, list_item_6], Direction=unit_z_2)
join_curves_2 = JoinCurves(Curves=deconstruct_brep_4.Edges, Preserve=False)
area_3 = Area(Geometry=extrude)  # -> Area, Centroid
area_4 = Area(Geometry=extrude_2)  # -> Area, Centroid
evaluate_surface = EvaluateSurface(Surface=extrude, Point=area_3.Centroid)  # -> Point, Normal, UDirection, VDirection, Frame
evaluate_surface_2 = EvaluateSurface(Surface=extrude_2, Point=area_4.Centroid)  # -> Point, Normal, UDirection, VDirection, Frame
vector_display = VectorDisplay(Anchor=area_3.Centroid, Vector=evaluate_surface.Normal)
reverse = Reverse(Vector=evaluate_surface.Normal)
number_slider_2 = Slider(0.5, range=0..1)  # disabled
vector_display_2 = VectorDisplay(Anchor=area_4.Centroid, Vector=evaluate_surface_2.Normal)
reverse_2 = Reverse(Vector=evaluate_surface_2.Normal)
number_slider_3 = Slider(0.5, range=0..1)  # disabled
amplitude = Amplitude(Vector=reverse, Amplitude="20")
division_5 = Division(A=number_slider, B="-2")
symask = LBSkyMask(context=extrude, center=area.Centroid, scale=number_slider_2)  # -> out, context_mask, orient_mask, strategy_mask, sky_mask, context_view, orient_view, strategy_view, sky_view; disabled; plug-in component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
amplitude_2 = Amplitude(Vector=reverse_2, Amplitude="20")
division_6 = Division(A=street_width, B="-2")
symask_2 = LBSkyMask(context=extrude_2, center=area_2.Centroid, scale=number_slider_3)  # -> out, context_mask, orient_mask, strategy_mask, sky_mask, context_view, orient_view, strategy_view, sky_view; disabled; plug-in component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
offset_curve = OffsetCurve(Curve=merge, Distance=division_5, Corners=1)
offset_curve_2 = OffsetCurve(Curve=merge, Distance="-5", Corners=1)
extrude_3 = Extrude(Base=extrude, Direction=amplitude)
offset_curve_3 = OffsetCurve(Curve=merge_2, Distance=division_6, Corners=1)
offset_curve_4 = OffsetCurve(Curve=merge_2, Distance="-5", Corners=1)
extrude_4 = Extrude(Base=extrude_2, Direction=amplitude_2)
deconstruct_brep_5 = DeconstructBrep(Brep=extrude_3)  # -> Faces, Edges, Vertices
deconstruct_brep_6 = DeconstructBrep(Brep=extrude_4)  # -> Faces, Edges, Vertices
series_2 = Series(Start="5", Step="5", Count="10")

# ---- group: EXPORT JSON
python_3_script = Python3Script(P=plane_surface, B=extrude_3)  # -> out; inputs P: Brep, B: list of Brep; disabled
# ---------- python_3_script: Python ----------
import Rhino.Geometry as rg
import json
import os

# Inputs:
# P : Surface or Brep (the base plane)
# B : List of Breps (buildings)

# Parameters
cell_size = 1.0  # 1 meter resolution

# -------------------
# Step 1: Get bounding box of the plane
bbox = P.GetBoundingBox(True)

min_x = bbox.Min.X
min_y = bbox.Min.Y
max_x = bbox.Max.X
max_y = bbox.Max.Y

# Step 2: Get centroid of plane — this becomes our origin (0, 0)
center_pt = bbox.Center
origin_x = center_pt.X
origin_y = center_pt.Y

# Step 3: Store relative positions of buildings
buildings_data = []

for brep in B:
    box = brep.GetBoundingBox(True)

    # Building position relative to origin
    x = box.Min.X - origin_x
    y = box.Min.Y - origin_y
    width = box.Max.X - box.Min.X
    depth = box.Max.Y - box.Min.Y
    height = box.Max.Z - box.Min.Z

    buildings_data.append({
        "x": x,
        "y": y,
        "width": width,
        "depth": depth,
        "height": height
    })

# Step 4: Export JSON structure
export_data = {
    "cell_size": cell_size,
    "origin": [0.0, 0.0],
    "plane_size": [max_x - min_x, max_y - min_y],
    "buildings": buildings_data
}

# Step 5: Save to file
output_folder = r"C:\Users\Andrea\Desktop\thesis\dsm_export" 
if not os.path.exists(output_folder):
    os.makedirs(output_folder)

json_path = os.path.join(output_folder, "dsm_data.json")
with open(json_path, "w") as f:
    json.dump(export_data, f, indent=2)

# Output confirmation
a = f"✅ DSM JSON saved to: {json_path}"
# ---------- end python_3_script ----------

# ----
list_item_8 = ListItem(List=deconstruct_brep_5.Faces, Index="4", Wrap=True)
bld_height = Panel("""30
30""")
list_item_9 = ListItem(List=deconstruct_brep_6.Faces, Index="4", Wrap=True)
series_3 = Series(Start=0, Step="30", Count="7")
deconstruct_brep_7 = DeconstructBrep(Brep=list_item_8)  # -> Faces, Edges, Vertices
bld_height_2 = Panel("""50
50""")
bld_height_3 = Panel("""50
50""")
deconstruct_brep_8 = DeconstructBrep(Brep=list_item_9)  # -> Faces, Edges, Vertices
python_3_script_2 = Python3Script(path="C:\Users\Ardo\Desktop\thesis\data\dsm_045deg.json")  # -> out, B, S
# ---------- python_3_script_2: Python ----------
import json
import Rhino.Geometry as rg

def load_dsm_json(path):
    with open(path, 'r') as f:
        data = json.load(f)

    # Containers for Rhino geometries
    building_curves = []
    street_curve = None

    # Parse building footprints
    for b in data.get("buildings", []):
        footprint = b.get("footprint", [])
        if footprint:
            points = [rg.Point3d(x, y, 0) for x, y in footprint]
            polyline = rg.Polyline(points)
            if not polyline.IsClosed:
                polyline.Add(points[0])  # ensure closed
            building_curves.append(polyline.ToNurbsCurve())

    # Parse street polygon (single closed curve)
    street = data.get("street", [])
    if street:
        points = [rg.Point3d(x, y, 0) for x, y in street]
        polyline = rg.Polyline(points)
        if not polyline.IsClosed:
            polyline.Add(points[0])
        street_curve = polyline.ToNurbsCurve()

    return building_curves, street_curve

# Call the function
B, S = load_dsm_json(path)
# ---------- end python_3_script_2 ----------
join_curves_3 = JoinCurves(Curves=deconstruct_brep_7.Edges, Preserve=False)  # -> flatten(Curves)

# ---- group: EXPORT ROTATED JSON
python_3_script_3 = Python3Script(P=plane_surface, C=join_curves_3, A=series_3, H=bld_height_2)  # -> out, a; inputs P: Brep, C: list of Curve, A: list of Int32, H: list; disabled
# ---------- python_3_script_3: Python ----------
import Rhino.Geometry as rg
import json
import os
import math

# Parameters
cell_size = 1.0
origin = rg.Point3d(0, 0, 0)
output_folder = r"C:\Users\Andrea\Desktop\thesis\rotated_json"

if not os.path.exists(output_folder):
    os.makedirs(output_folder)

# Plane bounds (centered)
bbox = P.GetBoundingBox(True)
min_x, min_y = bbox.Min.X, bbox.Min.Y
max_x, max_y = bbox.Max.X, bbox.Max.Y
plane_size = [max_x - min_x, max_y - min_y]

# Validate input sizes
if len(C) != len(H):
    raise Exception("❌ Curve list and height list must match.")

# Rotation loop
for angle_deg in A:
    angle_rad = math.radians(angle_deg)
    rotation = rg.Transform.Rotation(angle_rad, rg.Vector3d(0, 0, 1), origin)

    buildings_data = []

    for i, crv in enumerate(C):
        height = H[i]

        if not crv.IsClosed:
            print("⚠️ Skipping open curve")
            continue

        # Rotate curve
        crv_rot = crv.Duplicate()
        crv_rot.Transform(rotation)

        # Try to get polyline for clean export
        success, poly = crv_rot.TryGetPolyline()
        if not success:
            print("⚠️ Skipping non-polyline curve")
            continue

        if poly.Count < 4:
            print("⚠️ Skipping degenerate footprint")
            continue

        # Build cleaned footprint (XY)
        pts = [[pt.X, pt.Y] for pt in poly]
        if pts[0] != pts[-1]:
            pts.append(pts[0])  # Ensure closed

        buildings_data.append({
            "footprint": pts,
            "height": height
        })

    # Prepare JSON export
    export_data = {
        "cell_size": cell_size,
        "origin": [min_x, max_y],  # upper-left of original plane
        "plane_size": plane_size,
        "rotation_degrees": angle_deg,
        "buildings": buildings_data
    }

    # Save JSON
    filename = f"dsm_{angle_deg:03d}deg.json"
    path = os.path.join(output_folder, filename)
    with open(path, "w") as f:
        json.dump(export_data, f, indent=2)

# Output to Grasshopper
a = f"✅ Exported {len(A)} JSON files with {len(C)} footprints each to:\n{output_folder}"
# ---------- end python_3_script_3 ----------

# ----
python_3_script_4 = Python3Script()  # -> out, a
# ---------- python_3_script_4: Python ----------
from Grasshopper import DataTree
from Grasshopper.Kernel.Data import GH_Path

# Inputs expected:
# Widths      : list[float]
# Step        : int (default 5)
# AllowRepeat : bool (default True)
# Ordered     : bool (default True)

def allowed_heights_for_width(W, step=5):
    """Allowed heights = {5,10,..., W+5} inclusive."""
    W = float(W)
    max_h = int(round(W)) + step
    return list(range(step, max_h + 1, step))

Pairs = DataTree[float]()      # each branch: [hA, hB]
Counts = []                    # number of pairs per width
Allowed_tree = DataTree[int]() # optional: shows allowed set per width

# defaults if inputs are None
if Step is None: Step = 5
if AllowRepeat is None: AllowRepeat = True
if Ordered is None: Ordered = True

for wi, W in enumerate(Widths):
    allowed = allowed_heights_for_width(W, step=Step)
    # debug/inspection: allowed set per width
    path_allowed = GH_Path(wi)
    for a in allowed:
        Allowed_tree.Add(int(a), path_allowed)

    n = len(allowed)
    count = 0

    if Ordered:
        # ordered pairs
        for i, ha in enumerate(allowed):
            for j, hb in enumerate(allowed):
                if not AllowRepeat and ha == hb:
                    continue
                path = GH_Path(wi, count)  # one branch per pair
                Pairs.Add(float(ha), path)
                Pairs.Add(float(hb), path)
                count += 1
    else:
        # unordered combinations
        for i in range(n):
            j_start = i if AllowRepeat else i + 1
            for j in range(j_start, n):
                ha, hb = allowed[i], allowed[j]
                path = GH_Path(wi, count)
                Pairs.Add(float(ha), path)
                Pairs.Add(float(hb), path)
                count += 1

    Counts.append(count)
# ---------- end python_3_script_4 ----------
join_curves_4 = JoinCurves(Curves=deconstruct_brep_8.Edges, Preserve=False)  # -> flatten(Curves)
python_3_script_5 = Python3Script(
    output_folder="C:\Users\Ardo\Desktop\thesis\data",
    plane=plane_surface,
    curve_building=join_curves_3,
    rotation_angle=series_3,
    height_building=bld_height_3,
    street_polyline=join_curves)  # -> out, a; inputs plane: Brep, curve_building: list of Curve, rotation_angle: list of Int32, height_building: list, street_polyline: Curve; disabled
# ---------- python_3_script_5: Python ----------
import Rhino.Geometry as rg
import json
import os
import math

# Parameters
cell_size = 1.0
origin = rg.Point3d(0, 0, 0)
#output_folder = r"C:\Users\Andrea\Desktop\thesis\rotated_json"
P = plane
C = curve_building
A = rotation_angle
H = height_building
S = street_polyline

if not os.path.exists(output_folder):
    os.makedirs(output_folder)

# Plane size from unrotated P
bbox = P.GetBoundingBox(True)
min_x, min_y = bbox.Min.X, bbox.Min.Y
max_x, max_y = bbox.Max.X, bbox.Max.Y
plane_size = [max_x - min_x, max_y - min_y]

if len(C) != len(H):
    raise Exception("❌ Curve list and height list must match.")

# Rotation loop
for angle_deg in A:
    angle_rad = math.radians(angle_deg)
    rotation = rg.Transform.Rotation(angle_rad, rg.Vector3d(0, 0, 1), origin)

    # 🔹 Process buildings
    buildings_data = []
    building_centers = []
    building_heights = []

    for i, crv in enumerate(C):
        try:
            height = float(H[i])
        except:
            continue  # skip non-numeric heights

        if not crv.IsClosed:
            continue

        crv_rot = crv.Duplicate()
        crv_rot.Transform(rotation)

        success, poly = crv_rot.TryGetPolyline()
        if not success or poly.Count < 4:
            continue

        pts = [[pt.X, pt.Y] for pt in poly]
        if pts[0] != pts[-1]:
            pts.append(pts[0])

        center = crv_rot.PointAtNormalizedLength(0.5)
        building_centers.append(center)
        building_heights.append(height)

        buildings_data.append({
            "footprint": pts,
            "height": height
        })

    # 🔸 Process street curve
    street_data = None
    street_attributes = {}

    if S and S.IsClosed:
        S_rot = S.Duplicate()
        S_rot.Transform(rotation)

        success, poly = S_rot.TryGetPolyline()
        if success and poly.Count >= 4:
            street_pts = [[pt.X, pt.Y] for pt in poly]
            if street_pts[0] != street_pts[-1]:
                street_pts.append(street_pts[0])
            street_data = street_pts

            # ⬇️ Compute area, width, and building-side stats
            amp = rg.AreaMassProperties.Compute(S_rot)
            area = amp.Area
            width = area / 100.0
            centroid = amp.Centroid

            dir_vector = rg.Vector3d(math.cos(angle_rad), math.sin(angle_rad), 0)

            side1_heights = []
            side2_heights = []

            for i, center in enumerate(building_centers):
                vec = rg.Vector3d(center - centroid)
                cross = rg.Vector3d.CrossProduct(dir_vector, vec)
                if cross.Z > 0:
                    side1_heights.append(building_heights[i])
                else:
                    side2_heights.append(building_heights[i])

            all_heights = building_heights
            mean_height = sum(all_heights) / len(all_heights) if all_heights else 0.0
            mean_s1 = sum(side1_heights) / len(side1_heights) if side1_heights else 0.0
            mean_s2 = sum(side2_heights) / len(side2_heights) if side2_heights else 0.0
            avg_height = (mean_s1 + mean_s2) / 2.0 if (side1_heights or side2_heights) else 0.0
            lh_ratio = width / avg_height if avg_height > 0 else 0.0

            street_attributes = {
                "area": area,
                "width": width,
                "mean_building_height": mean_height,
                "mean_building_height_side1": mean_s1,
                "mean_building_height_side2": mean_s2,
                "lh_ratio": lh_ratio,
                "direction": angle_deg  # same as rotation
            }

    # 📝 Prepare JSON
    export_data = {
        "cell_size": cell_size,
        "origin": [min_x, max_y],
        "plane_size": plane_size,
        "rotation_degrees": angle_deg,
        "buildings": buildings_data
    }

    if street_data:
        export_data["street"] = street_data
        export_data["street_attributes"] = street_attributes  # 👈 added here

    # 💾 Save JSON
    filename = f"dsm_{angle_deg:03d}deg.json"
    path = os.path.join(output_folder, filename)
    with open(path, "w") as f:
        json.dump(export_data, f, indent=2)

a = f"✅ Exported {len(A)} JSON files with buildings + street to:\n{output_folder}"
# ---------- end python_3_script_5 ----------

bld_height_4 = Panel("""50
50""")
panel_4 = Panel(python_3_script_5.a)

entwine = Entwine(Branch00=bld_height_3, Branch01=bld_height, FlattenInputs=True)

# ---- group: EXPORT ROTATED JSON WITH STREET
python_3_script_6 = Python3Script(P=plane_surface, C=join_curves_3, A=series_3, H=bld_height_4, S=join_curves)  # -> out, a; inputs P: Brep, C: list of Curve, A: list of Int32, H: list, S: Curve; disabled
# ---------- python_3_script_6: Python ----------
import Rhino.Geometry as rg
import json
import os
import math

# Parameters
cell_size = 1.0
origin = rg.Point3d(0, 0, 0)
output_folder = r"C:\Users\Andrea\Desktop\thesis\rotated_json"

if not os.path.exists(output_folder):
    os.makedirs(output_folder)

# Plane size from unrotated P
bbox = P.GetBoundingBox(True)
min_x, min_y = bbox.Min.X, bbox.Min.Y
max_x, max_y = bbox.Max.X, bbox.Max.Y
plane_size = [max_x - min_x, max_y - min_y]

if len(C) != len(H):
    raise Exception("❌ Curve list and height list must match.")

# Rotation loop
for angle_deg in A:
    angle_rad = math.radians(angle_deg)
    rotation = rg.Transform.Rotation(angle_rad, rg.Vector3d(0, 0, 1), origin)

    # 🔹 Process buildings
    buildings_data = []
    for i, crv in enumerate(C):
        height = H[i]

        if not crv.IsClosed:
            continue

        crv_rot = crv.Duplicate()
        crv_rot.Transform(rotation)

        success, poly = crv_rot.TryGetPolyline()
        if not success or poly.Count < 4:
            continue

        pts = [[pt.X, pt.Y] for pt in poly]
        if pts[0] != pts[-1]:
            pts.append(pts[0])

        buildings_data.append({
            "footprint": pts,
            "height": height
        })

    # 🔸 Process street curve
    street_data = None
    if S and S.IsClosed:
        S_rot = S.Duplicate()
        S_rot.Transform(rotation)

        success, poly = S_rot.TryGetPolyline()
        if success and poly.Count >= 4:
            street_pts = [[pt.X, pt.Y] for pt in poly]
            if street_pts[0] != street_pts[-1]:
                street_pts.append(street_pts[0])
            street_data = street_pts

    # 📝 Prepare JSON
    export_data = {
        "cell_size": cell_size,
        "origin": [min_x, max_y],
        "plane_size": plane_size,
        "rotation_degrees": angle_deg,
        "buildings": buildings_data
    }

    if street_data:
        export_data["street"] = street_data

    # 💾 Save JSON
    filename = f"dsm_{angle_deg:03d}deg.json"
    path = os.path.join(output_folder, filename)
    with open(path, "w") as f:
        json.dump(export_data, f, indent=2)

a = f"✅ Exported {len(A)} JSON files with buildings + street to:\n{output_folder}"
# ---------- end python_3_script_6 ----------

# ----
panel_5 = Panel(python_3_script_3.a)
panel_6 = Panel("C:\Users\Ardo\Desktop\thesis\data")
bld_height_5 = Panel("""50
50""")
bld_height_6 = Panel("""50
50""")
series_4 = Series(Start=0, Step="30", Count="7")
python_3_script_7 = Python3Script(
    output_folder=panel_6,
    plane=plane_surface_3,
    street_widths=street_width,
    curve_building=join_curves_4,
    rotation_angle=series_4,
    height_building=bld_height_5,
    street_polyline=join_curves_2,
    run=Toggle(False))  # -> out, a, b; inputs plane: Brep, street_widths: list of Double, curve_building: list of Curve, rotation_angle: list of Int32, height_building: list, street_polyline: Curve
# ---------- python_3_script_7: Python ----------
import Rhino.Geometry as rg
import json
import os
import math

# Parameters
cell_size = 1.0
origin = rg.Point3d(0, 0, 0)

# Inputs
P = plane
C = curve_building
A = rotation_angle
H = height_building
S = street_polyline
W_list = street_widths

if run:  # ⬅️ Boolean toggle to control execution

    # Check output folder
    if not os.path.exists(output_folder):
        os.makedirs(output_folder)

    # Track filenames created
    exported_files = []  # ⬅️ New: list of filenames

    # Check input lengths
    if len(C) != len(H):
        raise Exception("❌ Curve list and height list must match.")

    # Get base plane bounding box once (assuming P is fixed)
    bbox = P.GetBoundingBox(True)
    min_x, min_y = bbox.Min.X, bbox.Min.Y
    max_x, max_y = bbox.Max.X, bbox.Max.Y
    plane_size = [max_x - min_x, max_y - min_y]

    # Loop over street widths
    for W_raw in W_list:
        try:
            W = float(W_raw)
        except:
            print(f"⚠️ Skipping invalid width: {W_raw}")
            continue

        # Loop over rotation angles
        for angle_deg in A:
            angle_rad = math.radians(angle_deg)
            rotation = rg.Transform.Rotation(angle_rad, rg.Vector3d(0, 0, 1), origin)

            buildings_data = []
            building_centers = []
            building_heights = []

            for i, crv in enumerate(C):
                try:
                    height = float(H[i])
                except:
                    print(f"⚠️ Skipping building {i}: invalid height '{H[i]}'")
                    continue

                if not crv.IsClosed:
                    continue

                crv_rot = crv.Duplicate()
                crv_rot.Transform(rotation)

                success, poly = crv_rot.TryGetPolyline()
                if not success or poly.Count < 4:
                    continue

                pts = [[round(pt.X, 3), round(pt.Y, 3)] for pt in poly]
                if pts[0] != pts[-1]:
                    pts.append(pts[0])

                center = crv_rot.PointAtNormalizedLength(0.5)
                building_centers.append(center)
                building_heights.append(height)

                buildings_data.append({
                    "footprint": pts,
                    "height": height
                })

            # Process street
            street_data = None
            street_attributes = {}

            if S and S.IsClosed:
                S_rot = S.Duplicate()
                S_rot.Transform(rotation)

                success, poly = S_rot.TryGetPolyline()
                if success and poly.Count >= 4:
                    street_pts = [[round(pt.X, 3), round(pt.Y, 3)] for pt in poly]
                    if street_pts[0] != street_pts[-1]:
                        street_pts.append(street_pts[0])
                    street_data = street_pts

                    amp = rg.AreaMassProperties.Compute(S_rot)
                    area = amp.Area
                    centroid = amp.Centroid

                    width = W  # use provided width
                    dir_vector = rg.Vector3d(math.cos(angle_rad), math.sin(angle_rad), 0)

                    side1_heights = []
                    side2_heights = []

                    for i, center in enumerate(building_centers):
                        vec = rg.Vector3d(center - centroid)
                        cross = rg.Vector3d.CrossProduct(dir_vector, vec)
                        if cross.Z > 0:
                            side1_heights.append(building_heights[i])
                        else:
                            side2_heights.append(building_heights[i])

                    all_heights = building_heights
                    mean_height = sum(all_heights) / len(all_heights) if all_heights else 0.0
                    mean_s1 = sum(side1_heights) / len(side1_heights) if side1_heights else 0.0
                    mean_s2 = sum(side2_heights) / len(side2_heights) if side2_heights else 0.0
                    avg_height = (mean_s1 + mean_s2) / 2.0 if (side1_heights or side2_heights) else 0.0
                    lh_ratio = width / avg_height if avg_height > 0 else 0.0

                    street_attributes = {
                        "area": area,
                        "width": width,
                        "mean_building_height": mean_height,
                        "mean_building_height_side1": mean_s1,
                        "mean_building_height_side2": mean_s2,
                        "lh_ratio": lh_ratio,
                        "direction": angle_deg
                    }

            # Prepare JSON data
            export_data = {
                "cell_size": cell_size,
                "origin": [min_x, max_y],
                "plane_size": plane_size,
                "rotation_degrees": angle_deg,
                "buildings": buildings_data
            }

            if street_data:
                export_data["street"] = street_data
                export_data["street_attributes"] = street_attributes

            # Save JSON file
            width_tag = f"width{int(W):02d}"  # 0.5 → 50 → width50
            angle_tag = f"deg{int(angle_deg):03d}"  # 30 → deg030
            filename = f"{width_tag}_{angle_tag}.json"
            path = os.path.join(output_folder, filename)

            with open(path, "w") as f:
                json.dump(export_data, f, indent=2)

            # Collect filename
            exported_files.append(filename)

    # Output summary
    a = f"✅ Exported {len(exported_files)} JSON files to:\n{output_folder}"
    b = exported_files  # ⬅️ List of filenames

else:
    a = "⏸️ Script not run. Toggle 'run' to True to export."
    b = []  # ⬅️ Empty list if not run
# ---------- end python_3_script_7 ----------
python_3_script_8 = Python3Script(
    output_folder=panel_6,
    plane=plane_surface_3,
    curve_building=join_curves_4,
    rotation_angle=series_4,
    height_building=bld_height_6,
    street_polyline=join_curves_2)  # -> out, a; inputs plane: Brep, curve_building: list of Curve, rotation_angle: list of Int32, height_building: list, street_polyline: Curve; disabled; same code as python_3_script_5

panel_7 = Panel(python_3_script_7.a)

concatenate = Concatenate(FragmentA=panel_6, FragmentA_2="\", FragmentB="width40_deg030.json")
list_item_10 = ListItem(List=concatenate, Index=Slider(0, range=0..20), Wrap=True)
panel_8 = Panel(list_item_10)
python_3_script_9 = Python3Script(path=list_item_10)  # -> out, B, S; same code as python_3_script_2
colibri_iterator = ColibriIterator(street_width=street_width, RemoteFly=False, ignoreAllWarningMsg=False)  # -> Street_width, Value_N, IterationGenome
colibri_parameters = ColibriParameters()
iteration_selection = IterationSelection()
colibri_aggregator = ColibriAggregator(Folder="c:\Colibri", IterationGenomeID=colibri_iterator.IterationGenome, Write=False, recordingMode=3)
