# Grasshopper definition 09_json_to_grasshopper.gh (Grasshopper 1.0.8)
# plug-ins: Heteroptera

number_slider = Slider(554, range=0..952)
python_3_script = Python3Script(folder="C:\Users\Ardo\Desktop\thesis\exported_grids_local", index=number_slider)  # -> out, points, values, filename; inputs index: Int32
# ---------- python_3_script: Python ----------
import os
from Rhino.Geometry import Point3d

# 1. List all CSV files
files = sorted([f for f in os.listdir(folder) if f.endswith(".csv")])
if not files:
    raise Exception("No CSV files found in folder.")

# 2. Clamp slider index
index = max(0, min(index, len(files)-1))
selected = os.path.join(folder, files[index])
filename = files[index]

# 3. Read file and parse points + MRT values
points = []
values = []

with open(selected, "r") as f:
    lines = f.readlines()[1:]  # skip header

    for line in lines:
        parts = line.strip().split(",")
        if len(parts) != 3:
            continue
        x, y, mrt = map(float, parts)
        pt = Point3d(x, y, 0)  # Flat grid, Z = 0
        points.append(pt)
        values.append(mrt)
# ---------- end python_3_script ----------
plane_surface = PlaneSurface(Plane=PlaneXY(0, 0, 0), XSize="-75 to 75", YSize="-75 to 75")
python_3_script_2 = Python3Script(folder_path="C:\Users\Ardo\Desktop\thesis\post_processed", index=number_slider)  # -> out, selected_file, data, file_count; inputs folder_path: String, index: Int32
# ---------- python_3_script_2: Python ----------
import os
import json

# === List all JSON files in folder
all_files = sorted([
    f for f in os.listdir(folder_path)
    if f.endswith(".json")
])

# === Total file count
file_count = len(all_files)

# === Handle slider index safely
index = 0 if index is None else int(index)
index = max(0, min(index, file_count - 1))

# === Select and load file
selected_file = os.path.join(folder_path, all_files[index])
with open(selected_file, "r") as f:
    data = json.load(f)

# === Outputs
a = selected_file     # File path
b = data              # JSON content
c = file_count        # Total number of JSON files
# ---------- end python_3_script_2 ----------
panel = Panel(python_3_script_2.file_count)
panel_2 = Panel(python_3_script_2.selected_file)
genpts = LBGeneratePointGrid(geometry=plane_surface, grid_size="1", offset_dist="0.1")  # -> points, vectors, face_areas, mesh; plug-in component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
python_3_script_3 = Python3Script(json_path=python_3_script_2.selected_file)  # -> out, a, b, c
# ---------- python_3_script_3: Python ----------
import json
from Rhino.Geometry import Point3d, Polyline, PolylineCurve, Surface, Vector3d, Brep

# === Load the JSON file
with open(json_path, "r") as f:
    data = json.load(f)

# === Helper to convert 2D point to Point3d
def to_point3d(p):
    return Point3d(p[0], p[1], 0)

# === Street geometry
street_pts = [to_point3d(p) for p in data.get("street", [])]
if street_pts and street_pts[0] != street_pts[-1]:
    street_pts.append(street_pts[0])
street_poly = PolylineCurve(Polyline(street_pts)) if street_pts else None

# === Building outlines and capped volumes
building_curves = []
building_solids = []

for b in data.get("buildings", []):
    footprint = b.get("footprint", [])
    height = b.get("height", 0)

    if len(footprint) >= 3:
        pts = [to_point3d(p) for p in footprint]
        if pts[0] != pts[-1]:
            pts.append(pts[0])
        poly = Polyline(pts)
        curve = PolylineCurve(poly)
        building_curves.append(curve)

        # Extrude as surface
        direction = Vector3d(0, 0, height)
        surface = Surface.CreateExtrusion(curve, direction)
        if surface:
            brep = surface.ToBrep()
            if brep:
                # Cap planar holes to make it a solid
                capped = brep.CapPlanarHoles(1e-6)
                if capped:
                    building_solids.append(capped)

from Rhino.Geometry import Plane, Point3d, Vector3d

# === Extract global base plane info
origin_xy = data.get("origin", [0, 0])
rotation_deg = data.get("rotation_degrees", 0)

# Convert to Point3d
origin_pt = Point3d(origin_xy[0], origin_xy[1], 0)

# Handle rotation (if any)
if rotation_deg == 0:
    global_plane = Plane(origin_pt, Vector3d.XAxis, Vector3d.YAxis)
else:
    import math
    angle_rad = math.radians(rotation_deg)
    x_axis = Vector3d(math.cos(angle_rad), math.sin(angle_rad), 0)
    y_axis = Vector3d(-math.sin(angle_rad), math.cos(angle_rad), 0)
    global_plane = Plane(origin_pt, x_axis, y_axis)


# === Outputs
a = street_poly        # Street polyline
b = building_curves    # Building outlines
c = building_solids    # Capped building Breps (solids)
# ---------- end python_3_script_3 ----------
brep = Brep(python_3_script_3.a)
brep_2 = Brep(python_3_script_3.b)
brep_3 = Brep(python_3_script_3.c)
unit_z = UnitZ(Factor=1)
extrude = Extrude(Base=brep, Direction=unit_z)
point_in_brep = PointInBrep(Brep=extrude, Point=python_3_script.points, Strict=False)
cull_pattern = CullPattern(List=python_3_script.values, CullPattern=point_in_brep)
min_max = MinMax(Number=cull_pattern)  # -> Minimum, Maximum
cull_pattern_2 = CullPattern(List=python_3_script.points, CullPattern=point_in_brep)
text_tag_3d = TextTag3D(Location=cull_pattern_2, Text=cull_pattern, Size=Slider(0.2, range=0..1), Justification=7)
gradient = Gradient(
    LowerLimit=min_max.Minimum,
    UpperLimit=min_max.Maximum,
    Parameter=cull_pattern,
    stops=[0.15: RGB(255, 130, 160), 0.85: RGB(220, 0, 40)])
cloud_display = CloudDisplay(Points=cull_pattern_2, Colours=gradient, Size=1, SpriteType=0)
dot_display = DotDisplay(Point=cull_pattern_2, Colour=gradient, Size=1)
