# Grasshopper definition 01_parametric_urban canyon.gh (Grasshopper 1.0.8)

panel = Panel("100")
number_slider = Slider(10, range=2..10, expression="x*5")
plane_surface = PlaneSurface(Plane=PlaneXY(0, 0, 0), XSize="-75 to 75", YSize="-75 to 75")
plane_surface_2 = PlaneSurface(Plane=PlaneXY(0, 0, 0), XSize="-50 to 50", YSize="-50 to 50")
division = Division(A="100", B=2)
division_2 = Division(A=number_slider, B=2)
radians = Radians(Degrees=Slider(0, range=0..7, expression="x*22.5"))
point = Point(Point(0, 0, -1))
center_box = CenterBox(Base=point, X=division, Y=division_2, Z=1)
rotate = Rotate(Geometry=center_box, Angle=radians, Plane=PlaneXY(0, 0, 0))  # -> Geometry, Transform
deconstruct_brep = DeconstructBrep(Brep=rotate.Geometry)  # -> Faces, Edges, Vertices
multiplication = Multiplication(A=number_slider, B=Slider(1, range=0.2..2))
list_item = ListItem(List=deconstruct_brep.Faces, Index="5", Wrap=True)
area = Area(Geometry=list_item)  # -> Area, Centroid
unit_z = UnitZ(Factor=multiplication)
deconstruct_brep_2 = DeconstructBrep(Brep=list_item)  # -> Faces, Edges, Vertices
list_item_2 = ListItem(List=deconstruct_brep_2.Edges, Index="2", Wrap=True)
list_item_3 = ListItem(List=deconstruct_brep_2.Edges, Index="0", Wrap=True)
merge = Merge(Data1=list_item_2, Data2=list_item_3)
genpts = LBGeneratePointGrid(geometry=list_item, grid_size="1", offset_dist="- 0.1")  # -> points, vectors, face_areas, mesh; plug-in component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
extrude = Extrude(Base=[list_item_3, list_item_2], Direction=unit_z)
join_curves = JoinCurves(Curves=deconstruct_brep_2.Edges, Preserve=False)
area_2 = Area(Geometry=extrude)  # -> Area, Centroid
evaluate_surface = EvaluateSurface(Surface=extrude, Point=area_2.Centroid)  # -> Point, Normal, UDirection, VDirection, Frame
vector_display = VectorDisplay(Anchor=area_2.Centroid, Vector=evaluate_surface.Normal)
reverse = Reverse(Vector=evaluate_surface.Normal)
number_slider_2 = Slider(0.5, range=0..1)  # disabled
amplitude = Amplitude(Vector=reverse, Amplitude="20")
division_3 = Division(A=number_slider, B="-2")
symask = LBSkyMask(context=extrude, center=area.Centroid, scale=number_slider_2)  # -> out, context_mask, orient_mask, strategy_mask, sky_mask, context_view, orient_view, strategy_view, sky_view; disabled; plug-in component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
offset_curve = OffsetCurve(Curve=merge, Distance=division_3, Corners=1)
offset_curve_2 = OffsetCurve(Curve=merge, Distance="-5", Corners=1)
extrude_2 = Extrude(Base=extrude, Direction=amplitude)
deconstruct_brep_3 = DeconstructBrep(Brep=extrude_2)  # -> Faces, Edges, Vertices

# ---- group: EXPORT JSON
python_3_script = Python3Script(P=plane_surface, B=extrude_2)  # -> out; inputs P: Brep, B: list of Brep; disabled
# ---------- python_3_script: Python ----------
import Rhino.Geometry as rg
import json
import os

# Inputs:
# P : Surface or Brep (the base plane)
# B : List of Breps (buildings)

# Parameters
cell_size = 1.0  # 1 meter resolution

# -------------------
# Step 1: Get bounding box of the plane
bbox = P.GetBoundingBox(True)

min_x = bbox.Min.X
min_y = bbox.Min.Y
max_x = bbox.Max.X
max_y = bbox.Max.Y

# Step 2: Get centroid of plane — this becomes our origin (0, 0)
center_pt = bbox.Center
origin_x = center_pt.X
origin_y = center_pt.Y

# Step 3: Store relative positions of buildings
buildings_data = []

for brep in B:
    box = brep.GetBoundingBox(True)

    # Building position relative to origin
    x = box.Min.X - origin_x
    y = box.Min.Y - origin_y
    width = box.Max.X - box.Min.X
    depth = box.Max.Y - box.Min.Y
    height = box.Max.Z - box.Min.Z

    buildings_data.append({
        "x": x,
        "y": y,
        "width": width,
        "depth": depth,
        "height": height
    })

# Step 4: Export JSON structure
export_data = {
    "cell_size": cell_size,
    "origin": [0.0, 0.0],
    "plane_size": [max_x - min_x, max_y - min_y],
    "buildings": buildings_data
}

# Step 5: Save to file
output_folder = r"C:\Users\Andrea\Desktop\thesis\dsm_export" 
if not os.path.exists(output_folder):
    os.makedirs(output_folder)

json_path = os.path.join(output_folder, "dsm_data.json")
with open(json_path, "w") as f:
    json.dump(export_data, f, indent=2)

# Output confirmation
a = f"✅ DSM JSON saved to: {json_path}"
# ---------- end python_3_script ----------

# ----
list_item_4 = ListItem(List=deconstruct_brep_3.Faces, Index="4", Wrap=True)
series = Series(Start=0, Step="45", Count="4")
deconstruct_brep_4 = DeconstructBrep(Brep=list_item_4)  # -> Faces, Edges, Vertices
bld_height = Panel("""50
50""")
python_3_script_2 = Python3Script(path="C:\Users\Ardo\Desktop\thesis\data\dsm_045deg.json")  # -> out, B, S
# ---------- python_3_script_2: Python ----------
import json
import Rhino.Geometry as rg

def load_dsm_json(path):
    with open(path, 'r') as f:
        data = json.load(f)

    # Containers for Rhino geometries
    building_curves = []
    street_curve = None

    # Parse building footprints
    for b in data.get("buildings", []):
        footprint = b.get("footprint", [])
        if footprint:
            points = [rg.Point3d(x, y, 0) for x, y in footprint]
            polyline = rg.Polyline(points)
            if not polyline.IsClosed:
                polyline.Add(points[0])  # ensure closed
            building_curves.append(polyline.ToNurbsCurve())

    # Parse street polygon (single closed curve)
    street = data.get("street", [])
    if street:
        points = [rg.Point3d(x, y, 0) for x, y in street]
        polyline = rg.Polyline(points)
        if not polyline.IsClosed:
            polyline.Add(points[0])
        street_curve = polyline.ToNurbsCurve()

    return building_curves, street_curve

# Call the function
B, S = load_dsm_json(path)
# ---------- end python_3_script_2 ----------
join_curves_2 = JoinCurves(Curves=deconstruct_brep_4.Edges, Preserve=False)  # -> flatten(Curves)

# ---- group: EXPORT ROTATED JSON
python_3_script_3 = Python3Script(P=plane_surface, C=join_curves_2, A=series, H=bld_height)  # -> out, a; inputs P: Brep, C: list of Curve, A: list of Int32, H: list; disabled
# ---------- python_3_script_3: Python ----------
import Rhino.Geometry as rg
import json
import os
import math

# Parameters
cell_size = 1.0
origin = rg.Point3d(0, 0, 0)
output_folder = r"C:\Users\Andrea\Desktop\thesis\rotated_json"

if not os.path.exists(output_folder):
    os.makedirs(output_folder)

# Plane bounds (centered)
bbox = P.GetBoundingBox(True)
min_x, min_y = bbox.Min.X, bbox.Min.Y
max_x, max_y = bbox.Max.X, bbox.Max.Y
plane_size = [max_x - min_x, max_y - min_y]

# Validate input sizes
if len(C) != len(H):
    raise Exception("❌ Curve list and height list must match.")

# Rotation loop
for angle_deg in A:
    angle_rad = math.radians(angle_deg)
    rotation = rg.Transform.Rotation(angle_rad, rg.Vector3d(0, 0, 1), origin)

    buildings_data = []

    for i, crv in enumerate(C):
        height = H[i]

        if not crv.IsClosed:
            print("⚠️ Skipping open curve")
            continue

        # Rotate curve
        crv_rot = crv.Duplicate()
        crv_rot.Transform(rotation)

        # Try to get polyline for clean export
        success, poly = crv_rot.TryGetPolyline()
        if not success:
            print("⚠️ Skipping non-polyline curve")
            continue

        if poly.Count < 4:
            print("⚠️ Skipping degenerate footprint")
            continue

        # Build cleaned footprint (XY)
        pts = [[pt.X, pt.Y] for pt in poly]
        if pts[0] != pts[-1]:
            pts.append(pts[0])  # Ensure closed

        buildings_data.append({
            "footprint": pts,
            "height": height
        })

    # Prepare JSON export
    export_data = {
        "cell_size": cell_size,
        "origin": [min_x, max_y],  # upper-left of original plane
        "plane_size": plane_size,
        "rotation_degrees": angle_deg,
        "buildings": buildings_data
    }

    # Save JSON
    filename = f"dsm_{angle_deg:03d}deg.json"
    path = os.path.join(output_folder, filename)
    with open(path, "w") as f:
        json.dump(export_data, f, indent=2)

# Output to Grasshopper
a = f"✅ Exported {len(A)} JSON files with {len(C)} footprints each to:\n{output_folder}"
# ---------- end python_3_script_3 ----------

# ----
panel_2 = Panel(python_3_script_3.a)

bld_height_2 = Panel("""50
50""")

python_3_script_4 = Python3Script(
    output_folder="C:\Users\Ardo\Desktop\thesis\data",
    plane=plane_surface,
    curve_building=join_curves_2,
    rotation_angle=series,
    height_building=bld_height_2,
    street_polyline=join_curves)  # -> out, a; inputs plane: Brep, curve_building: list of Curve, rotation_angle: list of Int32, height_building: list, street_polyline: Curve
# ---------- python_3_script_4: Python ----------
import Rhino.Geometry as rg
import json
import os
import math

# Parameters
cell_size = 1.0
origin = rg.Point3d(0, 0, 0)
#output_folder = r"C:\Users\Andrea\Desktop\thesis\rotated_json"
P = plane
C = curve_building
A = rotation_angle
H = height_building
S = street_polyline

if not os.path.exists(output_folder):
    os.makedirs(output_folder)

# Plane size from unrotated P
bbox = P.GetBoundingBox(True)
min_x, min_y = bbox.Min.X, bbox.Min.Y
max_x, max_y = bbox.Max.X, bbox.Max.Y
plane_size = [max_x - min_x, max_y - min_y]

if len(C) != len(H):
    raise Exception("❌ Curve list and height list must match.")

# Rotation loop
for angle_deg in A:
    angle_rad = math.radians(angle_deg)
    rotation = rg.Transform.Rotation(angle_rad, rg.Vector3d(0, 0, 1), origin)

    # 🔹 Process buildings
    buildings_data = []
    building_centers = []
    building_heights = []

    for i, crv in enumerate(C):
        try:
            height = float(H[i])
        except:
            continue  # skip non-numeric heights

        if not crv.IsClosed:
            continue

        crv_rot = crv.Duplicate()
        crv_rot.Transform(rotation)

        success, poly = crv_rot.TryGetPolyline()
        if not success or poly.Count < 4:
            continue

        pts = [[pt.X, pt.Y] for pt in poly]
        if pts[0] != pts[-1]:
            pts.append(pts[0])

        center = crv_rot.PointAtNormalizedLength(0.5)
        building_centers.append(center)
        building_heights.append(height)

        buildings_data.append({
            "footprint": pts,
            "height": height
        })

    # 🔸 Process street curve
    street_data = None
    street_attributes = {}

    if S and S.IsClosed:
        S_rot = S.Duplicate()
        S_rot.Transform(rotation)

        success, poly = S_rot.TryGetPolyline()
        if success and poly.Count >= 4:
            street_pts = [[pt.X, pt.Y] for pt in poly]
            if street_pts[0] != street_pts[-1]:
                street_pts.append(street_pts[0])
            street_data = street_pts

            # ⬇️ Compute area, width, and building-side stats
            amp = rg.AreaMassProperties.Compute(S_rot)
            area = amp.Area
            width = area / 100.0
            centroid = amp.Centroid

            dir_vector = rg.Vector3d(math.cos(angle_rad), math.sin(angle_rad), 0)

            side1_heights = []
            side2_heights = []

            for i, center in enumerate(building_centers):
                vec = rg.Vector3d(center - centroid)
                cross = rg.Vector3d.CrossProduct(dir_vector, vec)
                if cross.Z > 0:
                    side1_heights.append(building_heights[i])
                else:
                    side2_heights.append(building_heights[i])

            all_heights = building_heights
            mean_height = sum(all_heights) / len(all_heights) if all_heights else 0.0
            mean_s1 = sum(side1_heights) / len(side1_heights) if side1_heights else 0.0
            mean_s2 = sum(side2_heights) / len(side2_heights) if side2_heights else 0.0
            avg_height = (mean_s1 + mean_s2) / 2.0 if (side1_heights or side2_heights) else 0.0
            lh_ratio = width / avg_height if avg_height > 0 else 0.0

            street_attributes = {
                "area": area,
                "width": width,
                "mean_building_height": mean_height,
                "mean_building_height_side1": mean_s1,
                "mean_building_height_side2": mean_s2,
                "lh_ratio": lh_ratio,
                "direction": angle_deg  # same as rotation
            }

    # 📝 Prepare JSON
    export_data = {
        "cell_size": cell_size,
        "origin": [min_x, max_y],
        "plane_size": plane_size,
        "rotation_degrees": angle_deg,
        "buildings": buildings_data
    }

    if street_data:
        export_data["street"] = street_data
        export_data["street_attributes"] = street_attributes  # 👈 added here

    # 💾 Save JSON
    filename = f"dsm_{angle_deg:03d}deg.json"
    path = os.path.join(output_folder, filename)
    with open(path, "w") as f:
        json.dump(export_data, f, indent=2)

a = f"✅ Exported {len(A)} JSON files with buildings + street to:\n{output_folder}"
# ---------- end python_3_script_4 ----------

# ---- group: EXPORT ROTATED JSON WITH STREET
python_3_script_5 = Python3Script(P=plane_surface, C=join_curves_2, A=series, H=bld_height_2, S=join_curves)  # -> out, a; inputs P: Brep, C: list of Curve, A: list of Int32, H: list, S: Curve; disabled
# ---------- python_3_script_5: Python ----------
import Rhino.Geometry as rg
import json
import os
import math

# Parameters
cell_size = 1.0
origin = rg.Point3d(0, 0, 0)
output_folder = r"C:\Users\Andrea\Desktop\thesis\rotated_json"

if not os.path.exists(output_folder):
    os.makedirs(output_folder)

# Plane size from unrotated P
bbox = P.GetBoundingBox(True)
min_x, min_y = bbox.Min.X, bbox.Min.Y
max_x, max_y = bbox.Max.X, bbox.Max.Y
plane_size = [max_x - min_x, max_y - min_y]

if len(C) != len(H):
    raise Exception("❌ Curve list and height list must match.")

# Rotation loop
for angle_deg in A:
    angle_rad = math.radians(angle_deg)
    rotation = rg.Transform.Rotation(angle_rad, rg.Vector3d(0, 0, 1), origin)

    # 🔹 Process buildings
    buildings_data = []
    for i, crv in enumerate(C):
        height = H[i]

        if not crv.IsClosed:
            continue

        crv_rot = crv.Duplicate()
        crv_rot.Transform(rotation)

        success, poly = crv_rot.TryGetPolyline()
        if not success or poly.Count < 4:
            continue

        pts = [[pt.X, pt.Y] for pt in poly]
        if pts[0] != pts[-1]:
            pts.append(pts[0])

        buildings_data.append({
            "footprint": pts,
            "height": height
        })

    # 🔸 Process street curve
    street_data = None
    if S and S.IsClosed:
        S_rot = S.Duplicate()
        S_rot.Transform(rotation)

        success, poly = S_rot.TryGetPolyline()
        if success and poly.Count >= 4:
            street_pts = [[pt.X, pt.Y] for pt in poly]
            if street_pts[0] != street_pts[-1]:
                street_pts.append(street_pts[0])
            street_data = street_pts

    # 📝 Prepare JSON
    export_data = {
        "cell_size": cell_size,
        "origin": [min_x, max_y],
        "plane_size": plane_size,
        "rotation_degrees": angle_deg,
        "buildings": buildings_data
    }

    if street_data:
        export_data["street"] = street_data

    # 💾 Save JSON
    filename = f"dsm_{angle_deg:03d}deg.json"
    path = os.path.join(output_folder, filename)
    with open(path, "w") as f:
        json.dump(export_data, f, indent=2)

a = f"✅ Exported {len(A)} JSON files with buildings + street to:\n{output_folder}"
# ---------- end python_3_script_5 ----------

# ----
panel_3 = Panel(python_3_script_4.a)
