# Grasshopper definition 00_back_to_rhino.gh (Grasshopper 1.0.8)
# plug-ins: MeshEdit Components, SpiderWeb :: Graph Tools, DeCodingSpaces, Urbano, LunchBox

python_3_script = Python3Script(folder="C:\Users\Andrea\Desktop\thesis2\patches_combined", index=Slider(50, range=0..200))  # -> out, window, bldg_uncropped, bldg, tree, tmrt, road, selected_folder_name; inputs index: Int32
# ---------- python_3_script: Python ----------
import os

# === Inputs ===
# folder: base directory (string)
# index: selected subfolder index (integer)

# --- Validate folder existence ---
if not os.path.exists(folder):
    raise ValueError("Provided folder path does not exist.")

# --- Get list of subfolders ---
subfolders = [f for f in os.listdir(folder) if os.path.isdir(os.path.join(folder, f))]
subfolders.sort()

if not subfolders:
    raise ValueError("No subfolders found in selected directory.")

# --- Clamp index to available subfolders ---
index = max(0, min(index, len(subfolders) - 1))
selected_folder_name = subfolders[index]
selected_folder_path = os.path.join(folder, selected_folder_name)

# --- Helper to generate full file paths ---
def get_path(filename):
    return os.path.join(selected_folder_path, filename)

# --- File paths to extract ---
window         = get_path("window.geojson")
bldg           = get_path("buildings.geojson")
bldg_uncropped = get_path("buildings_uncropped.geojson")
tree           = get_path("trees.geojson")
road           = get_path("roads.geojson")
tmrt           = get_path("Tmrt_average.png")

# === Outputs ===
a = window
b = bldg
c = bldg_uncropped
d = tree
e = road
f = tmrt
g = selected_folder_name
# ---------- end python_3_script ----------
panel = Panel("C:\Users\Andrea\Desktop\thesis2\patches_new\patch_007_T09424E\trees.geojson")
panel_2 = Panel("C:\Users\Andrea\Desktop\thesis2\patches_new\patch_007_T09424E\window.geojson")
panel_3 = Panel("C:\Users\Andrea\Desktop\thesis2\patches_new\patch_007_T09424E\Tmrt_average.png")
panel_4 = Panel("C:\Users\Andrea\Desktop\thesis2\patches_new\patch_007_T09424E\buildings.geojson")
panel_5 = Panel("C:\Users\Andrea\Desktop\thesis2\patches_new\patch_007_T09424E\buildings_uncropped.geojson")
panel_6 = Panel("C:\Users\Andrea\Desktop\thesis2\patches_new\patch_007_T09424E\roads.geojson")
panel_7 = Panel("C:\Users\Andrea\Desktop\thesis\BCN_map\Landuse\BCN_UsosSòl_ETRS89_SHP.shp")
python_3_script_2 = Python3Script(filepath=python_3_script.tree)  # -> out, pts, crowns, trunks, heights, radii
# ---------- python_3_script_2: Python ----------
import json
import Rhino.Geometry as rg
from shapely.geometry import shape

# Default values
DEFAULT_HEIGHT = 8.0
DEFAULT_RADIUS = 6
DEFAULT_TRUNK_RADIUS = 0.15

# Input: filepath to trees.geojson
with open(filepath, 'r') as f:
    geo = json.load(f)

pts, crowns, trunks, heights, radii = [], [], [], [], []

for feature in geo['features']:
    props = feature.get("properties", {})
    geom = shape(feature["geometry"])

    # Get height from 'height' field
    height = props.get("height", DEFAULT_HEIGHT)
    crown_radius = props.get("COPA_RAD", DEFAULT_RADIUS)  # Optional field

    # Create base point
    if geom.geom_type == "Point":
        x, y = geom.x, geom.y
        base = rg.Point3d(x, y, 0)

        # Crown: sphere centered at 3/4 height
        crown_center = rg.Point3d(x, y, height - (height * 0.35))
        crown_sphere = rg.Sphere(crown_center, height * 0.35)
        crowns.append(crown_sphere)

        # Trunk: cylinder from base to height
        top = rg.Point3d(x, y, height)
        trunk = rg.Cylinder(rg.Circle(base, DEFAULT_TRUNK_RADIUS), height).ToBrep(True, True)
        trunks.append(trunk)

        pts.append(base)
        heights.append(height)
        radii.append(crown_radius)

# Outputs
a = pts       # Tree base points
b = crowns    # Tree crowns (spheres)
c = trunks    # Tree trunks (cylinders)
d = heights   # Heights
e = radii     # Crown radii
# ---------- end python_3_script_2 ----------
python_3_script_3 = Python3Script(filepath=python_3_script.bldg_uncropped)  # -> out, base_crvs, heights, ids
# ---------- python_3_script_3: Python ----------
import json
import Rhino.Geometry as rg
from shapely.geometry import shape
from ghpythonlib.treehelpers import list_to_tree

# === Inputs ===
# filepath: string path to the GeoJSON file

with open(filepath, 'r') as f:
    data = json.load(f)

base_crvs = []
heights = []
ids = []

for feature in data["features"]:
    props = feature["properties"]
    geom = shape(feature["geometry"])

    z_min = props.get("Z_MIN_VOL", 0)
    z_max = props.get("Z_MAX_VOL", 0)
    height = z_max - z_min

    # handle MultiPolygon → iterate rings
    if geom.geom_type == "MultiPolygon":
        for poly in geom.geoms:
            outer = poly.exterior.coords
            pts = [rg.Point3d(x, y, 0) for x, y in outer]
            if len(pts) < 3:
                continue

            polyline = rg.Polyline(pts)
            if polyline.IsClosed:
                base_crv = polyline.ToNurbsCurve()
                base_crvs.append(base_crv)
                heights.append(height)
                ids.append(feature["id"])
    else:
        print("❌ Unsupported geometry:", geom.geom_type)

# === Outputs ===
a = base_crvs      # footprint curves
b = heights        # extrusion heights (float)
c = ids            # feature IDs
# ---------- end python_3_script_3 ----------
python_3_script_4 = Python3Script(filepath=python_3_script.bldg)  # -> out, footprints, heights, ids
# ---------- python_3_script_4: Python ----------
import json
import Rhino.Geometry as rg
from shapely.geometry import shape
from ghpythonlib.treehelpers import list_to_tree

# === Customize this ===
HEIGHT_FIELD = "height"  # <-- Change this to match your file if needed
DEFAULT_HEIGHT = 10.0

with open(filepath, 'r') as f:
    data = json.load(f)

footprints = []
heights = []
ids = []

for feature in data["features"]:
    props = feature.get("properties", {})
    geom = shape(feature["geometry"])
    
    height = props.get(HEIGHT_FIELD, DEFAULT_HEIGHT)
    bid = str(feature.get("id", ""))

    if geom.geom_type == "Polygon":
        rings = [geom.exterior.coords]
    elif geom.geom_type == "MultiPolygon":
        rings = [poly.exterior.coords for poly in geom.geoms]
    else:
        continue  # Skip unsupported types

    for coords in rings:
        pts = [rg.Point3d(x, y, 0) for x, y in coords]
        if len(pts) < 3:
            continue
        polyline = rg.Polyline(pts)
        if polyline.IsClosed:
            curve = polyline.ToNurbsCurve()
            footprints.append(curve)
            heights.append(height)
            ids.append(bid)

# Outputs
a = footprints  # curves
b = heights     # extrusion heights
c = ids         # feature IDs
# ---------- end python_3_script_4 ----------
python_3_script_5 = Python3Script(filepath=python_3_script.window)  # -> out, a
# ---------- python_3_script_5: Python ----------
# requirements: shapely
import json
from shapely.geometry import shape
import Rhino.Geometry as rg

geojson_path = filepath  # string input
polygons = []

with open(geojson_path, 'r') as f:
    geo = json.load(f)

for feature in geo["features"]:
    geom = shape(feature["geometry"])

    if geom.geom_type == 'Polygon':
        # Outer ring only (no holes)
        coords = geom.exterior.coords
        pts = [rg.Point3d(x, y, 0) for x, y in coords]
        polyline = rg.Polyline(pts)
        if polyline.IsClosed:
            polygons.append(polyline.ToPolylineCurve())

a = polygons  # output
# ---------- end python_3_script_5 ----------
python_3_script_6 = Python3Script(filepath=python_3_script.road)  # -> out, crvs, attrs, ids
# ---------- python_3_script_6: Python ----------
import json
import Rhino.Geometry as rg
from shapely.geometry import shape
from ghpythonlib.treehelpers import list_to_tree

with open(filepath, 'r') as f:
    data = json.load(f)

crvs = []
ids = []
attrs = []

for feature in data["features"]:
    geom = shape(feature["geometry"])
    props = feature.get("properties", {})
    fid = feature.get("id", "")

    if geom.geom_type == "LineString":
        pts = [rg.Point3d(x, y, 0) for x, y in geom.coords]
        polyline = rg.Polyline(pts)
        crvs.append(polyline.ToNurbsCurve())
        ids.append(fid)
        attrs.append(props)

    elif geom.geom_type == "MultiLineString":
        for line in geom.geoms:
            pts = [rg.Point3d(x, y, 0) for x, y in line.coords]
            polyline = rg.Polyline(pts)
            crvs.append(polyline.ToNurbsCurve())
            ids.append(fid)
            attrs.append(props)

    else:
        continue  # Unsupported geometry

# Outputs
a = crvs
b = ids
c = attrs
# ---------- end python_3_script_6 ----------
import_shapefile_features = ImportShapefileFeatures(ShapefilePath=panel_7, Reproject=True)  # -> Points, Metadata, UTMZone, TranslationVector
import_image = ImportImage(File=python_3_script.tmrt, Rectangle=python_3_script_5.a)
boundary_surfaces = BoundarySurfaces(Edges=python_3_script_5.a)
unit_z = UnitZ(Factor=python_3_script_3.heights)
curve = Curve(python_3_script_5.a)
boundary_surfaces_2 = BoundarySurfaces(Edges=python_3_script_4.footprints)
unit_z_2 = UnitZ(Factor=python_3_script_4.heights)
boundary_surfaces_3 = BoundarySurfaces(Edges=python_3_script_3.base_crvs)
mesh_area = MeshArea(Mesh=import_image)  # -> Area, Centroid
extrude = Extrude(Base=boundary_surfaces_3, Direction=unit_z)
extrude_2 = Extrude(Base=boundary_surfaces_2, Direction=unit_z_2)
curve_2 = Curve(python_3_script_6.crvs)
rotate = Rotate(Geometry=import_image, Angle=degrees("270"), Plane=mesh_area.Centroid)  # -> Geometry, Transform
custom_preview = CustomPreview(Geometry=[python_3_script_2.crowns, python_3_script_2.trunks], Material=ColourSwatch(SwatchColor=RGB(59, 112, 50)))
custom_preview_2 = CustomPreview(Geometry=extrude, Material=ColourSwatch(SwatchColor=RGB(166, 166, 166)))
custom_preview_3 = CustomPreview(Geometry=extrude_2, Material=ColourSwatch(SwatchColor=RGB(166, 166, 166)))
move = Move(Geometry=curve, Motion=import_shapefile_features.TranslationVector)  # -> Geometry, Transform
move_2 = Move(Geometry=extrude, Motion=import_shapefile_features.TranslationVector)  # -> Geometry, Transform
move_3 = Move(
    Geometry=[extrude_2, rotate.Geometry, python_3_script_2.crowns, python_3_script_2.trunks, curve_2],
    Motion=import_shapefile_features.TranslationVector)  # -> Geometry, Transform
move_4 = Move(Geometry=extrude_2, Motion=import_shapefile_features.TranslationVector)  # -> Geometry, Transform
curve_3 = Curve(move.Geometry)
import_shapefile_features_2 = ImportShapefileFeatures(
    ShapefilePath=panel_7,
    Reproject=True,
    UTMZone=import_shapefile_features.UTMZone,
    TranslationVector=import_shapefile_features.TranslationVector,
    CroppingGeometry=curve_3)  # -> Points, Metadata, UTMZone, TranslationVector
polyline = PolyLine(Vertices=import_shapefile_features_2.Points, Closed=False)
boundary_surfaces_4 = BoundarySurfaces(Edges=curve_3)
genpts = LBGeneratePointGrid(geometry=boundary_surfaces_4, grid_size="10", offset_dist="1")  # -> points, vectors, face_areas, mesh; plug-in component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
visualgraph = VisualGraph()
analysis_grid = AnalysisGrid()  # -> AnalysisPoints, GridCells
quad_grid = QuadGrid(UDivisions=10, VDivisions=10)  # -> CornerPoint1, CornerPoint2, CornerPoint3, CornerPoint4, MidPoint, Normals
graphedgelist = GraphEdgeList()
graphvertexlist = GraphVertexList()
point_in_breps = PointInBreps(Brep=move_4.Geometry, Point=genpts.points, Strict=False)  # -> Inside, Index
dispatch = Dispatch(List=genpts.points, DispatchPattern=point_in_breps.Inside)  # -> ListA, ListB
viewfactors = LBViewFactors()  # -> out, view_vecs, patch_mesh, view_factors, int_mtx; plug-in component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
humantosky = LBHumanToSkyRelation()  # -> out, human_points, human_line, fract_body_exp, sky_exposure; plug-in component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
skyview = HBSkyView()  # -> out, results; plug-in component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
point = Point(dispatch.ListA)  # disabled
point_2 = Point(dispatch.ListB)
symask = LBSkyMask(context=move_4.Geometry, center=genpts.points)  # -> out, context_mask, orient_mask, strategy_mask, sky_mask, context_view, orient_view, strategy_view, sky_view; plug-in component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
gradient = Gradient(LowerLimit="0", UpperLimit="1", Parameter=symask.sky_view, stops=[0: RGB(0, 0, 0), 1: RGB(255, 255, 255)])
text_tag = TextTag(Location=genpts.points, Text=symask.sky_view)
dot_display = DotDisplay(Point=genpts.points, Colour=gradient, Size=1)
