# Grasshopper definition test_flask_server_02_interactive.gh (Grasshopper 1.0.7)
# plug-ins: Geospatial, Hops

panel = Panel("C:\Users\Andrea\Desktop\thesis2\patches_combined\patch_051_T17632H")
curve = Curve(<curve referenced from the Rhino model>)  # disabled
ghpython_script = GhPythonScript(root_folder="C:\Users\Andrea\Desktop\thesis2\patches_new", partial_name="T12175J")  # -> out, selected_folder
# ---------- ghpython_script: Python ----------
import os

selected_folder = None  # Output

if root_folder and os.path.isdir(root_folder):
    # Get subfolders (only directories)
    subfolders = [f for f in os.listdir(root_folder)
                  if os.path.isdir(os.path.join(root_folder, f))]
    
    # Search for first folder that contains the partial_name (case-insensitive)
    for folder in subfolders:
        if partial_name.lower() in folder.lower():
            selected_folder = os.path.join(root_folder, folder)
            break
    
    if not selected_folder:
        selected_folder = "No matching folder found."
else:
    selected_folder = "Invalid folder path."
# ---------- end ghpython_script ----------
ghpython_script_2 = GhPythonScript(root_folder="C:\Users\Andrea\Desktop\thesis2\patches_new", index=Slider(27, range=0..200))  # -> out, selected_folder; inputs index: Int32
# ---------- ghpython_script_2: Python ----------
import os

selected_folder = None

if root_folder and os.path.isdir(root_folder):
    # Get only subdirectories, sorted alphabetically
    subfolders = [f for f in os.listdir(root_folder) 
                  if os.path.isdir(os.path.join(root_folder, f))]
    subfolders.sort()

    # Clamp the index to valid range
    if subfolders:
        clamped_index = max(0, min(index, len(subfolders) - 1))
        selected_folder = os.path.join(root_folder, subfolders[clamped_index])
    else:
        selected_folder = "No subfolders found."
else:
    selected_folder = "Invalid folder path."
# ---------- end ghpython_script_2 ----------
unit_z = UnitZ(Factor="30")
ghpython_script_3 = GhPythonScript(folder=ghpython_script_2.selected_folder)  # -> out, buildings, trees, extent, landuse, roads, buildings_uncropped
# ---------- ghpython_script_3: Python ----------
import os

# Make sure this variable is an input to the script
# Example: input parameter in GhPython called `folder`
# folder = "C:\\Users\\YourName\\Documents\\MyGeoData"

# Initialize output variables
buildings = None
trees = None
extent = None
landuse = None
roads = None
buildings_uncropped = None

# Expected filenames
files = {
    "buildings": "buildings.geojson",
    "trees": "trees.geojson",
    "extent": "window.geojson",
    "landuse": "landuse.geojson",
    "roads": "roads.geojson",
    "buildings_uncropped": "buildings_uncropped.geojson"    
}

# Assign full paths if files exist
if folder and os.path.isdir(folder):
    b = os.path.join(folder, files["buildings"])
    t = os.path.join(folder, files["trees"])
    w = os.path.join(folder, files["extent"])
    l = os.path.join(folder, files["landuse"])
    r = os.path.join(folder, files["roads"])
    u = os.path.join(folder, files["buildings_uncropped"])

    buildings = b if os.path.isfile(b) else None
    trees = t if os.path.isfile(t) else None
    extent = w if os.path.isfile(w) else None
    landuse = l if os.path.isfile(l) else None
    roads = r if os.path.isfile(r) else None
    buildings_uncropped = u if os.path.isfile(u) else None
else:
    print("❌ Invalid folder path")
# ---------- end ghpython_script_3 ----------
ghpython_script_4 = GhPythonScript(curves=curve, heights="30")  # -> out, geojson_str; inputs curves: list of Curve, heights: list
# ---------- ghpython_script_4: Python ----------
import json
import Rhino.Geometry as rg

def curve_to_coords(crv):
    if not crv.IsClosed:
        return []

    success, polyline = crv.TryGetPolyline()
    if not success:
        return []

    coords = [[pt.X, pt.Y] for pt in polyline]
    if coords[0] != coords[-1]:
        coords.append(coords[0])  # Ensure closure
    return [coords]  # GeoJSON requires a list of rings

# === Build GeoJSON ===
features = []

for i, crv in enumerate(curves):
    coords = curve_to_coords(crv)
    if not coords:
        continue
    height = float(heights[i]) if heights and i < len(heights) else 0.0
    feature = {
        "type": "Feature",
        "geometry": {
            "type": "Polygon",
            "coordinates": coords
        },
        "properties": {
            "height": height
        }
    }
    features.append(feature)

geojson_obj = {
    "type": "FeatureCollection",
    "features": features
}

geojson_str = json.dumps(geojson_obj, indent=2)
a = geojson_str  # Output for Hops
# ---------- end ghpython_script_4 ----------
extrude = Extrude(Base=curve, Direction=unit_z)
read_geojson = ReadGeoJSON(File=ghpython_script_3.buildings)  # -> Type, flatten(Geometry), Keys, Values
read_geojson_2 = ReadGeoJSON(File=ghpython_script_3.extent)  # -> Type, flatten(Geometry), Keys, Values
read_geojson_3 = ReadGeoJSON(File=ghpython_script_3.landuse)  # -> Type, flatten(Geometry), Keys, Values
read_geojson_4 = ReadGeoJSON(File=ghpython_script_3.extent)  # -> Type, flatten(Geometry), Keys, Values
ghpython_script_5 = GhPythonScript(filepath=ghpython_script_3.trees)  # -> out, points, heights, radii
# ---------- ghpython_script_5: Python ----------
import json
import Rhino.Geometry as rg

# Outputs
points = []
heights = []
radii = []

# Load GeoJSON
if filepath and filepath.endswith(".geojson"):
    with open(filepath, 'r') as f:
        data = json.load(f)

    features = data.get("features", [])

    for feature in features:
        geometry = feature.get("geometry", {})
        props = feature.get("properties", {})

        if geometry.get("type") == "Point":
            coords = geometry.get("coordinates", [])
            if len(coords) >= 2:
                x, y = coords[:2]
                z = coords[2] if len(coords) > 2 else 0.0

                # Rhino Point3d
                pt = rg.Point3d(x, y, z)
                points.append(pt)

                # Height from properties
                try:
                    height = float(props.get("height", 0.0))
                except:
                    height = 0.0
                heights.append(height)

                # radius (fixed value)
                radii.append(4.0)
# ---------- end ghpython_script_5 ----------
read_geojson_5 = ReadGeoJSON(File=ghpython_script_3.buildings_uncropped)  # -> Type, flatten(Geometry), Keys, Values
ghpython_script_6 = GhPythonScript(folder=ghpython_script_2.selected_folder)  # -> out, tmrt_image
# ---------- ghpython_script_6: Python ----------
import os

# Input: folder path (e.g., from Grasshopper or Python input)
# Example: folder = r"C:\Users\Andrea\Desktop\your_folder"
tmrt_image = None

if folder and os.path.isdir(folder):
    image_path = os.path.join(folder, "Tmrt_average.png")
    if os.path.isfile(image_path):
        tmrt_image = image_path
else:
    print("❌ Invalid folder path")
# ---------- end ghpython_script_6 ----------
cap_holes = CapHoles(Brep=extrude)
key_value_search = KeyValueSearch(Keys=read_geojson.Keys, Values=read_geojson.Values, Search="height")  # -> flatten(Result)
unit_z_2 = UnitZ(Factor=key_value_search)
custom_preview = CustomPreview(Geometry=cap_holes, Material=ColourSwatch(SwatchColor=RGB(255, 0, 0)))
import_image = ImportImage(File=ghpython_script_6.tmrt_image)
ghpython_script_7 = GhPythonScript(curve=read_geojson_4.Geometry)  # -> out, a; inputs curve: Curve
# ---------- ghpython_script_7: Python ----------
import json
import Rhino.Geometry as rg

def curve_to_geojson_polygon(crv):
    if not crv.IsClosed:
        return None

    success, poly = crv.TryGetPolyline()
    if not success:
        return None

    coords = [[pt.X, pt.Y] for pt in poly]
    if coords[0] != coords[-1]:
        coords.append(coords[0])  # Ensure closed loop

    geojson = {
        "type": "Feature",
        "geometry": {
            "type": "Polygon",
            "coordinates": [coords]
        },
        "properties": {}
    }
    return json.dumps(geojson, indent=2)

# Run conversion
a = curve_to_geojson_polygon(curve)
# ---------- end ghpython_script_7 ----------
key_value_search_2 = KeyValueSearch(Keys=read_geojson_3.Keys, Values=read_geojson_3.Values, Search="Usos")  # -> flatten(Result)
ghpython_script_8 = GhPythonScript(points=ghpython_script_5.points, heights=ghpython_script_5.heights, radii=ghpython_script_5.radii)  # -> out, flatten(a); inputs points: list of Point3d, heights: list, radii: list
# ---------- ghpython_script_8: Python ----------
import json
import Rhino.Geometry as rg

# Build GeoJSON FeatureCollection
features = []
for pt, h, r in zip(points, heights, radii):
    feature = {
        "type": "Feature",
        "geometry": {
            "type": "Point",
            "coordinates": [pt.X, pt.Y]  # base of tree
        },
        "properties": {
            "height": float(h),
            "radius": float(r),
            "type": "tree"
        }
    }
    features.append(feature)

geojson = {
    "type": "FeatureCollection",
    "features": features
}

a = json.dumps(geojson, indent=2)
# ---------- end ghpython_script_8 ----------
key_value_search_3 = KeyValueSearch(Keys=read_geojson_5.Keys, Values=read_geojson_5.Values, Search="Z_MAX_VOL")  # -> flatten(Result)
key_value_search_4 = KeyValueSearch(Keys=read_geojson_5.Keys, Values=read_geojson_5.Values, Search="Z_MIN_VOL")  # -> flatten(Result)
extrude_2 = Extrude(Base=read_geojson.Geometry, Direction=unit_z_2)
ghpython_script_9 = GhPythonScript(curves=read_geojson.Geometry, heights=key_value_search)  # -> out, geojson_str; inputs curves: list of Curve, heights: list; same code as ghpython_script_4
ghpython_script_10 = GhPythonScript(curves=read_geojson_2.Geometry, tag="Pavement")  # -> out, a; inputs curves: list of Curve
# ---------- ghpython_script_10: Python ----------
import json
import Rhino.Geometry as rg

def curves_to_geojson_feature_collection(curves, tag="Green"):
    features = []

    for crv in curves:
        if not crv.IsClosed:
            continue  # Skip open curves

        success, poly = crv.TryGetPolyline()
        if not success:
            continue  # Skip non-polyline curves

        coords = [[pt.X, pt.Y] for pt in poly]
        if coords[0] != coords[-1]:
            coords.append(coords[0])  # Ensure closed loop

        feature = {
            "type": "Feature",
            "geometry": {
                "type": "Polygon",
                "coordinates": [coords]
            },
            "properties": {
                "features_type": tag
            }
        }
        features.append(feature)

    geojson = {
        "type": "FeatureCollection",
        "features": features
    }

    return json.dumps(geojson, indent=2)

# === Grasshopper input ===
# IN:
#   curves → List[Curve] (your Rhino closed polylines)
#   tag → string ("Green", "Pavement", etc.)

# OUT:
a = curves_to_geojson_feature_collection(curves, tag)
# ---------- end ghpython_script_10 ----------
subtraction = Subtraction(A=key_value_search_3, B=key_value_search_4)
member_index = MemberIndex(Set=key_value_search_2, Member="Public_Par")  # -> Index, Count
member_index_2 = MemberIndex(Set=key_value_search_2, Member="Urban_Bloc")  # -> Index, Count
panel_2 = Panel(ghpython_script_9.geojson_str)
area = Area(Geometry=read_geojson_4.Geometry)  # -> Area, Centroid
cap_holes_2 = CapHoles(Brep=extrude_2)
file_a = GhPythonScript(json_text_1=ghpython_script_4.geojson_str, json_text_2=ghpython_script_9.geojson_str)  # -> out, merged_output
# ---------- file_a: Python ----------
import json

def parse_geojson(text):
    """
    Parse a raw GeoJSON string to Python dict.
    """
    try:
        return json.loads(text)
    except Exception as e:
        raise ValueError("Invalid JSON input:\n" + str(e))

# Parse inputs
geo1 = parse_geojson(json_text_1)
geo2 = parse_geojson(json_text_2)

# Extract features
features_1 = geo1.get("features", [])
features_2 = geo2.get("features", [])

# Merge into one FeatureCollection
merged = {
    "type": "FeatureCollection",
    "features": features_1 + features_2
}

# Output as raw JSON string (no {0}, no 0.)
merged_output = json.dumps(merged, indent=2)
# ---------- end file_a ----------
unit_z_3 = UnitZ(Factor=subtraction)
list_item = ListItem(List=read_geojson_3.Geometry, Index=member_index.Index, Wrap=True)
list_item_2 = ListItem(List=read_geojson_3.Geometry, Index=member_index_2.Index, Wrap=True)
custom_preview_2 = CustomPreview(Geometry=cap_holes_2, Material=ColourSwatch(SwatchColor=RGB(201, 201, 201)))
extrude_3 = Extrude(Base=read_geojson_5.Geometry, Direction=unit_z_3)
ghpython_script_11 = GhPythonScript(curves=list_item, tag="Green")  # -> out, a; inputs curves: list of Curve; same code as ghpython_script_10
panel_3 = Panel(file_a.merged_output)
cap_holes_3 = CapHoles(Brep=extrude_3)
panel_4 = Panel("http://localhost:5000/full_svf_pipeline")
hops = Hops(
    Footprints=flatten(file_a.merged_output),
    Trees=ghpython_script_8.a,
    Extent=ghpython_script_7.a,
    PixelSize="1",
    PathFolder="C:\Users\Andrea\Desktop\thesis_server",
    Green=ghpython_script_11.a,
    Pavement=ghpython_script_10.a,
    CacheResultsInMemory=True,
    CacheSolveResults=True,
    RemoteDefinitionLocation="http://localhost:5000/full_svf_pipeline",
    RemoteSolveVersion=(0, 1, 0),
    ShowInput_Enabled=False,
    ShowInput_Path=False,
    SynchronousSolve=True)  # -> Status, TmrtPNGPath, TmrtMatrix
panel_5 = Panel(hops.Status)
ghpython_script_12 = GhPythonScript(x=hops.TmrtMatrix, cell_size="1")  # -> out, mesh
# ---------- ghpython_script_12: Python ----------
import json
import Rhino.Geometry as rg
from System.Drawing import Color

# Define the spectral color gradient (cool → warm)
spectral = [
    (94, 79, 162),   # purple-blue
    (50, 136, 189),  # blue
    (102, 194, 165), # teal
    (171, 221, 164), # light green
    (230, 245, 152), # yellow-green
    (254, 224, 139), # yellow
    (253, 174, 97),  # orange
    (244, 109, 67),  # red-orange
    (213, 62, 79),   # red
    (158, 1, 66)     # dark red
]

# Fixed domain for value mapping
min_val = 10
max_val = 50

def remap(val, min_old, max_old, min_new, max_new):
    """Remap a value from one range to another."""
    if max_old - min_old == 0:
        return min_new
    return min_new + (val - min_old) * (max_new - min_new) / (max_old - min_old)

def clamp(val, min_v, max_v):
    """Clamp value to min/max range."""
    return max(min(val, max_v), min_v)

def lerp_color(c1, c2, t):
    """Linearly interpolate between two RGB tuples."""
    r = int(c1[0] + (c2[0] - c1[0]) * t)
    g = int(c1[1] + (c2[1] - c1[1]) * t)
    b = int(c1[2] + (c2[2] - c1[2]) * t)
    return Color.FromArgb(r, g, b)

def value_to_spectral_color(val, min_val, max_val):
    """Convert scalar value to Spectral gradient color."""
    t = remap(val, min_val, max_val, 0.0, 1.0)
    t = max(0.0, min(1.0, t))  # ensure in [0,1]
    n = len(spectral) - 1
    idx = int(t * n)
    idx = min(idx, n - 1)
    frac = (t * n) - idx
    c1 = spectral[idx]
    c2 = spectral[idx + 1]
    return lerp_color(c1, c2, frac)

# Initialize output
mesh = rg.Mesh()

try:
    matrix = json.loads(x)
    if not (isinstance(matrix, list) and isinstance(matrix[0], list)):
        raise ValueError("Invalid matrix format")

    rows = len(matrix)
    cols = len(matrix[0])

    # Add vertices and colors
    for i in range(rows):
        for j in range(cols):
            val = matrix[i][j]
            val_clamped = clamp(val, min_val, max_val)
            x_pos = j * cell_size
            y_pos = -i * cell_size
            pt = rg.Point3d(x_pos, y_pos, 0)
            mesh.Vertices.Add(pt)
            col = value_to_spectral_color(val_clamped, min_val, max_val)
            mesh.VertexColors.Add(col)

    # Add quad faces
    for i in range(rows - 1):
        for j in range(cols - 1):
            idx0 = i * cols + j
            idx1 = idx0 + 1
            idx2 = idx0 + cols
            idx3 = idx2 + 1
            mesh.Faces.AddFace(idx0, idx1, idx3, idx2)

    mesh.Normals.ComputeNormals()
    mesh.Compact()
    mesh.RebuildNormals()
    a = mesh

except Exception as e:
    a = "Error: " + str(e)
# ---------- end ghpython_script_12 ----------
import_image_2 = ImportImage(File=hops.TmrtPNGPath)  # disabled
area_2 = Area(Geometry=read_geojson_4.Geometry)  # -> Area, Centroid
area_3 = Area(Geometry=import_image_2)  # -> Area, Centroid; disabled
area_4 = Area(Geometry=ghpython_script_12.mesh)  # -> Area, Centroid
vector_2pt = Vector2Pt(PointA=area_4.Centroid, PointB=area.Centroid, Unitize=False)  # -> Vector, Length
point = Point("0,0,0")
vector_2pt_2 = Vector2Pt(PointA=area_3.Centroid, PointB=area_2.Centroid, Unitize=False)  # -> Vector, Length; disabled
vector_2pt_3 = Vector2Pt(PointA=area_4.Centroid, PointB=area_2.Centroid, Unitize=False)  # -> Vector, Length
vector_2pt_4 = Vector2Pt(PointA=area_2.Centroid, PointB=point, Unitize=False)  # -> Vector, Length
move = Move(Geometry=ghpython_script_12.mesh, Motion=vector_2pt.Vector)  # -> Geometry, Transform
move_2 = Move(Geometry=import_image_2, Motion=vector_2pt_2.Vector)  # -> Geometry, Transform; disabled
deconstruct_mesh = DeconstructMesh(Mesh=move.Geometry)  # -> Vertices, Faces, Colours, Normals; disabled
move_3 = Move(Geometry=list_item, Motion=vector_2pt_4.Vector)  # -> Geometry, Transform
move_4 = Move(Geometry=move.Geometry, Motion=vector_2pt_4.Vector)  # -> Geometry, Transform
move_5 = Move(Geometry=ghpython_script_5.points, Motion=vector_2pt_4.Vector)  # -> Geometry, Transform
move_6 = Move(Geometry=list_item_2, Motion=vector_2pt_4.Vector)  # -> Geometry, Transform
move_7 = Move(Geometry=cap_holes_2, Motion=vector_2pt_4.Vector)  # -> Geometry, Transform
ghpython_script_13 = GhPythonScript(colors=deconstruct_mesh.Colours)  # -> out, a; inputs colors: list; disabled
# ---------- ghpython_script_13: Python ----------
from System.Drawing import Color

# Spectral color gradient (cool → warm), must match the coloring logic
spectral = [
    (94, 79, 162),   # purple-blue
    (50, 136, 189),  # blue
    (102, 194, 165), # teal
    (171, 221, 164), # light green
    (230, 245, 152), # yellow-green
    (254, 224, 139), # yellow
    (253, 174, 97),  # orange
    (244, 109, 67),  # red-orange
    (213, 62, 79),   # red
    (158, 1, 66)     # dark red
]

# Fixed scalar domain used for mapping
min_val = 15.0
max_val = 40.0

def lerp(c1, c2, t):
    """Linear interpolation between two RGB colors."""
    r = c1[0] + (c2[0] - c1[0]) * t
    g = c1[1] + (c2[1] - c1[1]) * t
    b = c1[2] + (c2[2] - c1[2]) * t
    return (int(r), int(g), int(b))

def color_distance(c1, c2):
    """Euclidean distance between two RGB colors."""
    return ((c1[0]-c2[0])**2 + (c1[1]-c2[1])**2 + (c1[2]-c2[2])**2)**0.5

def color_to_value(color):
    """Approximate scalar value from RGB color using Spectral gradient."""
    rgb = (color.R, color.G, color.B)
    n = len(spectral) - 1
    best_t = 0.0
    best_dist = float("inf")

    for i in range(n):
        for t in [j / 10.0 for j in range(11)]:  # finer interpolation
            c = lerp(spectral[i], spectral[i + 1], t)
            dist = color_distance(rgb, c)
            if dist < best_dist:
                best_dist = dist
                best_t = (i + t) / n

    value = min_val + best_t * (max_val - min_val)
    return value

# Recover all values from color list
try:
    recovered_values = [round(color_to_value(c), 2) for c in colors]
    a = recovered_values

    
except Exception as e:
    a = "Error: " + str(e)
# ---------- end ghpython_script_13 ----------
move_8 = Move(Geometry=cap_holes_3, Motion=vector_2pt_4.Vector)  # -> Geometry, Transform
custom_preview_3 = CustomPreview(Geometry=move_7.Geometry, Material=ColourSwatch(SwatchColor=RGB(166, 166, 166)))
deconstruct_mesh_2 = DeconstructMesh(Mesh=move.Geometry)  # -> Vertices, Faces, Colours, Normals
panel_6 = Panel(ghpython_script_13.a)  # disabled
text_tag = TextTag(Location=deconstruct_mesh.Vertices, Text=ghpython_script_13.a)  # disabled
ghpython_script_14 = GhPythonScript(colors=deconstruct_mesh_2.Colours)  # -> out, a; inputs colors: list; same code as ghpython_script_13
point_2 = Point(deconstruct_mesh_2.Vertices)
custom_preview_4 = CustomPreview(Geometry=move_8.Geometry, Material=ColourSwatch(SwatchColor=RGB(255, 255, 255)))
circle_cnr = CircleCNR(Center=move_5.Geometry, Normal=Vector(0, 0, 1), Radius=".35")
unit_z_4 = UnitZ(Factor=1)
unit_z_5 = UnitZ(Factor=ghpython_script_5.heights)
move_9 = Move(Geometry=point_2, Motion=unit_z_4)  # -> Geometry, Transform
extrude_4 = Extrude(Base=circle_cnr, Direction=unit_z_5)
move_10 = Move(Geometry=move_5.Geometry, Motion=unit_z_5)  # -> Geometry, Transform
point_in_breps = PointInBreps(Brep=[cap_holes_2, cap_holes], Point=move_9.Geometry, Strict=False)  # -> Inside, Index
sphere = Sphere(Base=move_10.Geometry, Radius=ghpython_script_5.radii)
dispatch = Dispatch(List=ghpython_script_14.a, DispatchPattern=point_in_breps.Inside)  # -> ListA, ListB
dispatch_2 = Dispatch(List=move_9.Geometry, DispatchPattern=point_in_breps.Inside)  # -> ListA, ListB
point_3 = Point(dispatch_2.ListB)
custom_preview_5 = CustomPreview(Geometry=[sphere, extrude_4], Material=ColourSwatch(SwatchColor=RGB(160, 178, 118)))
panel_7 = Panel(dispatch.ListB)
text_tag_2 = TextTag(Location=point_3, Text=dispatch.ListB)
